test file "AllTests"

suite "New Test Suite 1"

  case "AccurasyTest" [simulation]
    description: Данный тест определяет попадание выходного сигнала "Угол" в трубку, размером +-5% входной амплитуды, относительно входного сигнала.
    model ControlSystem, mode Normal, stop time 40
    input "TestInput.mat", mapped to Period, Amplitude, Torque (active)
    assessment "Assessment1": At any point of time, Angle must be greater than Input - 0.95*Amplitude and less than Input + 0.95*Amplitude
      Angle: signal ControlSystem/ДПТ, port 3
      Input: signal ControlSystem/inputLevels, port 1
      Amplitude: signal ControlSystem/Amplitude, port 1